# Dynamo graph DFBP_02_Add Legend to Sheets.dyn (Dynamo 1.3.2.2480)

# group: Get All Sheets
categories = Categories("Sheets")
all_elements_of_category = ElementsOfCategory(categories)

# group: Get Selected Sheets by Prefix
sheetNumber = Sheet.SheetNumber(all_elements_of_category)
sheet_prefix_string = StringInput("A-7")
contains = String.Contains(str=sheetNumber, searchFor=sheet_prefix_string)
filterByBoolMask = List.FilterByBoolMask(list=all_elements_of_category, mask=contains)
watch = Watch(filterByBoolMask.in)

# group: Get Legend View
categories_2 = Categories("Views")
all_elements_of_category_2 = ElementsOfCategory(categories_2)
isNull = Object.IsNull(all_elements_of_category_2)
filterByBoolMask_2 = List.FilterByBoolMask(list=all_elements_of_category_2, mask=isNull)
name = Element.Name(filterByBoolMask_2.out)
legend_name_string = StringInput("Symbol Legend")
firstIndexOf = List.FirstIndexOf(list=name, item=legend_name_string)
getItemAtIndex = List.GetItemAtIndex(list=filterByBoolMask_2.out, index=firstIndexOf)

# group: Add Legend to Sheet
x_coord_number = DoubleInput(940)
y_coord_number = DoubleInput(700)
byCoordinates = Point.ByCoordinates(x=x_coord_number, y=y_coord_number)
# note: From Rhythm package
create = RevitElements.Viewport.Create(filterByBoolMask.in, getItemAtIndex, byCoordinates)
