# Dynamo graph DFBP_03_Add Views to Sheets.dyn (Dynamo 1.3.2.2480)

# group: Get All Sheets
categories = Categories("Sheets")
all_elements_of_category = ElementsOfCategory(categories)

# group: Sort List Based on Sheets in Excel
sheetNumber = Sheet.SheetNumber(all_elements_of_category)

# group: Read Data from Excel
file_path = Filename(".\DFBP_03_Sheet List.xlsx")
fromPath = FileObject(file_path)  # "File.FromPath"
code_block = CodeBlock { "Sheet1"; }
boolean = BoolSelector(true)
readFromFile = Excel.ReadFromFile(file=fromPath, sheetName=code_block, readAsStrings=boolean)

# group: Remove Header, Reformat and Get Separate Lists
code_block_2 = CodeBlock { 0; }
removeItemAtIndex = List.RemoveItemAtIndex(list=readFromFile, indices=code_block_2)
transpose = List.Transpose(removeItemAtIndex)
isNull = Object.IsNull(transpose)
filterByBoolMask = List.FilterByBoolMask(list=transpose, mask=isNull)
code_block_3 = CodeBlock { 0; 2; }
getItemAtIndex = List.GetItemAtIndex(list=filterByBoolMask.out, index=code_block_3.out0)
getItemAtIndex_2 = List.GetItemAtIndex(list=filterByBoolMask.out, index=code_block_3.out1)

firstIndexOf = List.FirstIndexOf(list=sheetNumber, item=getItemAtIndex)

# group (continued): Sort List Based on Sheets in Excel
getItemAtIndex_3 = List.GetItemAtIndex(list=all_elements_of_category, index=firstIndexOf)

# group: Get All Views
categories_2 = Categories("Views")
all_elements_of_category_2 = ElementsOfCategory(categories_2)

# group: Remove Null Views
isNull_2 = Object.IsNull(all_elements_of_category_2)
filterByBoolMask_2 = List.FilterByBoolMask(list=all_elements_of_category_2, mask=isNull_2)

# group: Format List of Views
code_block_4 = CodeBlock { ","; }
split = String.Split(getItemAtIndex_2, code_block_4)
trimWhitespace = String.TrimWhitespace(split@L2)

# group: Sort View List Based on Sheets in Excel
name = Element.Name(filterByBoolMask_2.out)
firstIndexOf_2 = List.FirstIndexOf(list=name, item=trimWhitespace)
getItemAtIndex_4 = List.GetItemAtIndex(list=filterByBoolMask_2.out, index=firstIndexOf_2@L2)

watch = Watch(getItemAtIndex_4)

# group: Add Views to Sheet
number = DoubleInput(500)
number_2 = DoubleInput(400)
# note: From Rhythm Package
byCoordinates = Point.ByCoordinates(x=number, y=number_2)
create = RevitElements.Viewport.Create(getItemAtIndex_3, watch@L3, byCoordinates)
