# Dynamo graph DFBP_04_Duplicate Sheets and Views.dyn (Dynamo 1.3.2.2480)

# group: Duplicate Sheets and Views
duplicate = Revit.Sheet.Duplicate()  # unwired: arg0, arg1, arg2
run_boolean = BoolSelector(true)
duplicate_views_boolean = BoolSelector(true)
duplidate_option_number = DoubleInput(0)
# note: From BimorphNodes Package
suffix_string = StringInput("_test")
prefix_string = StringInput("")

# group: Get All Sheets
categories = Categories("Sheets")
all_elements_of_category = ElementsOfCategory(categories)

# group: Filter for Specific Sheets
sheet_number_to_duplicate_string = StringInput("A101")
create = List.Create(sheet_number_to_duplicate_string)
sheetNumber = Sheet.SheetNumber(all_elements_of_category)
containsItem = List.ContainsItem(list=create, item=sheetNumber)
filterByBoolMask = List.FilterByBoolMask(list=all_elements_of_category, mask=containsItem)

duplicate_2 = Revit.Sheet.Duplicate(filterByBoolMask.in, run_boolean, duplicate_views_boolean, duplidate_option_number, suffix_string, prefix_string)
