# Dynamo graph DFBP_06_Create View Filter.dyn (Dynamo 1.3.2.2480)

# group: Get Parameter
categories = Categories("Walls")
all_elements_of_category = ElementsOfCategory(categories)
number = DoubleInput(0)
getItemAtIndex = List.GetItemAtIndex(list=all_elements_of_category, index=number)
elementType = Element.ElementType(getItemAtIndex)
string = StringInput("Fire Rating")
parameterByName = Parameter.ParameterByName(element=elementType, name=string)

# group: Define Rule 1
select_rule_type = RuleTypes("BeginsWith")
string_2 = StringInput("1 HR")
byRuleType = Revit.Filter.FilterRule.ByRuleType(select_rule_type, string_2, parameterByName, lacing=Longest)

# group: Define Rule 2
select_rule_type_2 = RuleTypes("Equals")
string_3 = StringInput("2 HR")
byRuleType_2 = Revit.Filter.FilterRule.ByRuleType(select_rule_type_2, string_3, parameterByName, lacing=Longest)

# group: Define Rule 3
select_rule_type_3 = RuleTypes("Equals")
string_4 = StringInput("3 HR")
byRuleType_3 = Revit.Filter.FilterRule.ByRuleType(select_rule_type_3, string_4, parameterByName, lacing=Longest)

# group: Create List of Filter Rules
create = List.Create(byRuleType, byRuleType_2, byRuleType_3)

# group: Create Filter
string_5 = StringInput("Rated Walls")
categories_2 = Categories("Walls")
byRules = Revit.Filter.ParameterFilterElement.ByRules(string_5, categories_2, create)
