# Dynamo graph DFBP_08_Change Elevation Crop Line Weight.dyn (Dynamo 1.3.2.2480)

# group: Get Specific Views by Type and Name
# note: from archilab package
view_type = ViewTypesUi("Elevation")
getByType = archilab.Revit.Views.View.GetByType(view_type)
name = Element.Name(getByType)
string = StringInput("Elevation")
contains = String.Contains(str=name, searchFor=string)
filterByBoolMask = List.FilterByBoolMask(list=getByType, mask=contains)

# group: Update Crop Boundary Lineweight
number_slider = DoubleSlider(5, range=1..16 step 1)
# note: From Rhythm Package
overrideCrop = RevitElements.ViewSection.OverrideCrop(filterByBoolMask.in, number_slider)

# group: Get the Active View
current = Document.Current()
activeView = Document.ActiveView(current)

# group: Get Views on a Specific Sheet
categories = Categories("Sheets")
all_elements_of_category = ElementsOfCategory(categories)
sheetNumber = Sheet.SheetNumber(all_elements_of_category)
string_2 = StringInput("A302")
allIndicesOf = List.AllIndicesOf(list=sheetNumber, item=string_2)
getItemAtIndex = List.GetItemAtIndex(list=all_elements_of_category, index=allIndicesOf)
views = Sheet.Views(getItemAtIndex)
