# Dynamo graph DFBP_09_Hide Categories in Views.dyn (Dynamo 1.3.2.2480)

# group: Get Views by Type
# note: From archilab package
view_type = ViewTypesUi("CeilingPlan")
getByType = archilab.Revit.Views.View.GetByType(view_type)

# group: Select Categories to Turn Off
categories = Categories("Walls")
categories_2 = Categories("Floors")
categories_3 = Categories("Roofs")
categories_4 = Categories("StructuralColumns")
create = List.Create(categories, categories_2, categories_3, categories_4)

# group: Turn Off Categories in View(s)
byProperties = Revit.Filter.OverrideGraphicSettings.ByProperties()
boolean = BoolSelector(true)
setCategoryOverrides = View.SetCategoryOverrides(getByType, create, byProperties, boolean)
