# Dynamo graph DFBP_10_Create Views from Rooms.dyn (Dynamo 1.3.2.2480)

# group: Get All Rooms
categories = Categories("Rooms")
all_elements_of_category = ElementsOfCategory(categories)

# group: Filter Rooms by Level
string = StringInput("Level")
getParameterValueByName = Element.GetParameterValueByName(element=all_elements_of_category, parameterName=string)
levels = Levels("01 - Entry Level")
name = Level.Name(levels)
eq = getParameterValueByName == name
filterByBoolMask = List.FilterByBoolMask(list=all_elements_of_category, mask=eq)

# group: Filter Rooms by Room Name
name_2 = Room.Name(all_elements_of_category)
string_2 = StringInput("Office")
contains = String.Contains(str=name_2, searchFor=string_2)
filterByBoolMask_2 = List.FilterByBoolMask(list=all_elements_of_category, mask=contains)

# group: Create Views and Set View Scale
string_3 = StringInput("Enlarged")
number = DoubleInput(2)
boolean = BoolSelector(true)
byRoom = Custom[FloorPlan.ByRoom](Room=filterByBoolMask_2.in@L1, Prefix=string_3, Offset=number, RunIt=boolean)  # This node takes input of a Room and creates a Floor Plan View with Crop Box set around that room.
# note: From archilab package
number_2 = DoubleInput(50)
setScale = View.SetScale(view=byRoom, scale=number_2)
