# Dynamo graph DFBP_11_Create Floor Roof Walls from Points.dyn (Dynamo 1.3.2.2480)

# group: Define Coordinates
number_slider = DoubleSlider(40, range=0..100 step 1)
number_slider_2 = DoubleSlider(73, range=0..100 step 1)

# group: Create Corner Points
byCoordinates = Point.ByCoordinates()
byCoordinates_2 = Point.ByCoordinates(x=number_slider)
byCoordinates_3 = Point.ByCoordinates(x=number_slider, y=number_slider_2)
byCoordinates_4 = Point.ByCoordinates(y=number_slider_2)

# group: Create Lines from Points
byStartPointEndPoint = Line.ByStartPointEndPoint(startPoint=byCoordinates, endPoint=byCoordinates_2)
byStartPointEndPoint_2 = Line.ByStartPointEndPoint(startPoint=byCoordinates_2, endPoint=byCoordinates_3)
byStartPointEndPoint_3 = Line.ByStartPointEndPoint(startPoint=byCoordinates_3, endPoint=byCoordinates_4)
byStartPointEndPoint_4 = Line.ByStartPointEndPoint(startPoint=byCoordinates_4, endPoint=byCoordinates)

# group: Create Outline
create = List.Create(byStartPointEndPoint, byStartPointEndPoint_2, byStartPointEndPoint_3, byStartPointEndPoint_4)
byJoinedCurves = PolyCurve.ByJoinedCurves(create)

# group: Create Roof
string = StringInput("Generic - 9\"")
byName = RoofType.ByName(string)
levels = Levels("Level 2")
byOutlineTypeAndLevel = Roof.ByOutlineTypeAndLevel(outline=byJoinedCurves, roofType=byName, level=levels)

# group: Create Floor
floor_types = FloorTypes("Generic - 12\"")
levels_2 = Levels("Level 1")
byOutlineTypeAndLevel_2 = Floor.ByOutlineTypeAndLevel(outlineCurves=byJoinedCurves, floorType=floor_types, level=levels_2)

# group: Create Walls from Lines
levels_3 = Levels("Level 1")
levels_4 = Levels("Level 2")
wall_types = WallTypes("Storefront")
byCurveAndLevels = Wall.ByCurveAndLevels(byStartPointEndPoint, levels_3, levels_4, wall_types)
byCurveAndLevels_2 = Wall.ByCurveAndLevels(byStartPointEndPoint_2, levels_3, levels_4, wall_types)
byCurveAndLevels_3 = Wall.ByCurveAndLevels(byStartPointEndPoint_3, levels_3, levels_4, wall_types)
byCurveAndLevels_4 = Wall.ByCurveAndLevels(byStartPointEndPoint_4, levels_3, levels_4, wall_types)

watch_3d = Watch3D(byJoinedCurves)
