# Dynamo graph DFBP_12_MEP from Lines.dyn (Dynamo 1.3.2.2480)

# group: Get All Lines
element_types = ElementTypes("CurveElement")
all_elements_of_type = ElementsOfType(element_types)

# group: Filter for Model Lines
name = Element.Name(all_elements_of_type)
string = StringInput("Model Lines")
eq = name == string
filterByBoolMask = List.FilterByBoolMask(list=all_elements_of_type, mask=eq)

# group: Filter for Specific Line Style
string_2 = StringInput("Line Style")
getParameterValueByName = Element.GetParameterValueByName(element=filterByBoolMask.in, parameterName=string_2)
name_2 = Element.Name(getParameterValueByName)
string_3 = StringInput("Wide Lines")
eq_2 = name_2 == string_3
filterByBoolMask_2 = List.FilterByBoolMask(list=filterByBoolMask.in, mask=eq_2)

# group: Get All Pipe Types
element_types_2 = ElementTypes("PipeType")
all_elements_of_type_2 = ElementsOfType(element_types_2)

# group: Filter for Specific Type
name_3 = Element.Name(all_elements_of_type_2)
string_4 = StringInput("Standard")
firstIndexOf = List.FirstIndexOf(list=name_3, item=string_4)
getItemAtIndex = List.GetItemAtIndex(list=all_elements_of_type_2, index=firstIndexOf)
watch = Watch(name_3)

# group: Get All MEP System Types
element_types_3 = ElementTypes("MEPSystemType")
all_elements_of_type_3 = ElementsOfType(element_types_3)

# group: Filter for Specific Type
name_4 = Element.Name(all_elements_of_type_3)
string_5 = StringInput("Domestic Hot Water")
firstIndexOf_2 = List.FirstIndexOf(list=name_4, item=string_5)
getItemAtIndex_2 = List.GetItemAtIndex(list=all_elements_of_type_3, index=firstIndexOf_2)

# group: Create Pipes
curve = CurveElement.Curve(filterByBoolMask_2.in)
levels = Levels("Level 1")
# note: From MEPover Package
number = DoubleInput(6)
byLines = Custom[Pipe.ByLines](Lines=curve, PipeType=getItemAtIndex, SystemType=getItemAtIndex_2, Level=levels, Diameter=number)  # Creates a pipe by Line, PipeType, SystemType, Level and Diameter

byLines_2 = Custom[Conduit.ByLines]()  # Creates conduits by Line, ConduitType, Level and Diameter; unwired: Lines, ConduitType, Level, Diameter
byLines_3 = Custom[DuctRectangular.ByLines]()  # Create ducts by Lines, DuctType, MechanicalFittingType, Level, Width and Height; unwired: Lines, DuctType, MechanicalSystemType, Level, Width, Height
