# Dynamo graph DFBP_13_Create Grid and Place Elements.dyn (Dynamo 1.3.2.2480)

# group: Define Start Point
byCoordinates = Point.ByCoordinates()

# group: X Axis - Fixed Spacing Distance
number_slider = DoubleSlider(23, range=0..100 step 1)
spacing_number = DoubleInput(10)
sequence = Sequence(amount=number_slider, step=spacing_number, lacing=Longest)

# group: Y Axis - Fixed Spacing Distance
number_slider_2 = DoubleSlider(16, range=0..100 step 1)
spacing_number_2 = DoubleInput(15)
sequence_2 = Sequence(amount=number_slider_2, step=spacing_number_2, lacing=Longest)

# group: Create Sequence of Vectors
byCoordinates_2 = Vector.ByCoordinates(x=sequence)
byCoordinates_3 = Vector.ByCoordinates(y=sequence_2)

# group: Add Vectors to Start Point
add = Point.Add(point=byCoordinates, vectorToAdd=byCoordinates_2)
add_2 = Point.Add(point=add, vectorToAdd=byCoordinates_3, lacing=CrossProduct)

# group: Insert Family at Each Grid Point
family_types = FamilyTypes("Rectangular Column:18\" x 24\"")
levels = Levels("Level 2")
byPointAndLevel = FamilyInstance.ByPointAndLevel(familyType=family_types, point=add_2, level=levels)

# group: X Axis - Fixed Overall Distance
number_slider_3 = DoubleSlider(35, range=0..100 step 1)
overall_distance_number = DoubleInput(100)
div = overall_distance_number / number_slider_3
sequence_3 = Sequence(amount=number_slider_3, step=div, lacing=Longest)

# group: Y Axis - Fixed Overall Distance
number_slider_4 = DoubleSlider(35, range=0..100 step 1)
overall_distance_number_2 = DoubleInput(100)
div_2 = overall_distance_number_2 / number_slider_4
sequence_4 = Sequence(amount=number_slider_4, step=div_2, lacing=Longest)
