# Dynamo graph DFBP_14_Convert Filled Regions to 3D.dyn (Dynamo 1.3.2.2480)

# group: Get All Filled Regions
element_types = ElementTypes("FilledRegion")
all_elements_of_type = ElementsOfType(element_types)

# group: Get Filled Region Curves and Join
# note: From archilab package
filled_region_boundary_curves = Custom[Filled Region Boundary Curves](Filled_Region=all_elements_of_type)  # This node will get the boundary curves for a filled region.
byJoinedCurves = PolyCurve.ByJoinedCurves(filled_region_boundary_curves)

# group: Get Distance Between Levels
levels = Levels("Level 2")
elevation = Level.Elevation(levels)
levels_2 = Levels("Level 1")
elevation_2 = Level.Elevation(levels_2)
sub = elevation - elevation_2
code_block = CodeBlock(dist=sub) { -dist; }

# group: Create Dynamo 3D Solid
extrudeAsSolid = Curve.ExtrudeAsSolid(byJoinedCurves, code_block)
flatten = Flatten(extrudeAsSolid)

# group: Generate Unique Name for Each Shape
string = StringInput("Room_")
count = Count(flatten)
range = Range(end=count, lacing=Longest)
string_from_object = FromObject(range)
code_block_2 = CodeBlock(Prefix=string, Counter=string_from_object) { Prefix + Counter; }

# group: Create Direct Shape
# note: From Springs package
categories = Categories("GenericModel")
byGeometry = Custom[Springs.DirectShape.ByGeometry](geometry=flatten@L1, category=categories, name=code_block_2@L1)  # Convert the input geometry to DirectShape element inside the Revit document. It supports solids or surfaces. It is based on an alternative process that uses a SAT import and can produce smooth surfaces. Each created DS will have a unique type. Make sure that each input geometry has a unique name. You can either feed a single category for all geometries or a unique category for each geometry - the node's lacing is set to longest by default. The default category is Generic Models.
