# Dynamo graph DFBP_16_Insert Families by Room.dyn (Dynamo 1.3.2.2480)

# group: Read Excel File
file_path = Filename("C:\Users\micha\Google Drive\Courses\C2017-010_Dynamo for Busy People\Scripts\Paid\16 - Insert Families by Room\DFBP_16_Furniture List.xlsx")
fromPath = FileObject(file_path)  # "File.FromPath"
string = StringInput("Sheet1")
readFromFile = Excel.ReadFromFile(file=fromPath, sheetName=string)
number = DoubleInput(0)
removeItemAtIndex = List.RemoveItemAtIndex(list=readFromFile, indices=number)
transpose = List.Transpose(removeItemAtIndex)

# group: Separate Excel Data into Lists
number_2 = DoubleInput(1)
getItemAtIndex = List.GetItemAtIndex(list=transpose, index=number_2)
number_3 = DoubleInput(2)
getItemAtIndex_2 = List.GetItemAtIndex(list=transpose, index=number_3)
number_4 = DoubleInput(0)
getItemAtIndex_3 = List.GetItemAtIndex(list=transpose, index=number_4)
number_5 = DoubleInput(3)
getItemAtIndex_4 = List.GetItemAtIndex(list=transpose, index=number_5)

# group: Get Families and Family Types from Excel
byName = Family.ByName(getItemAtIndex)
types = Family.Types(byName)
name = FamilyType.Name(types)
containsItem = List.ContainsItem(list=getItemAtIndex_2, item=name@L2)
filterByBoolMask = List.FilterByBoolMask(list=types, mask=containsItem)
firstItem = List.FirstItem(filterByBoolMask.in@L2)

# group: Get Rooms and Room Names
categories = Categories("Rooms")
all_elements_of_category = ElementsOfCategory(categories)
string_2 = StringInput("Name")
getParameterValueByName = Element.GetParameterValueByName(element=all_elements_of_category, parameterName=string_2)

# group: Sort Family List by Excel
allIndicesOf = List.AllIndicesOf(list=getParameterValueByName, item=getItemAtIndex_3)
getItemAtIndex_5 = List.GetItemAtIndex(list=all_elements_of_category, index=allIndicesOf)

# group: Duplicate Rooms Based on Excel Quantities
cycle = List.Cycle()  # unwired: list, amount
combine = List.Combine(cycle, getItemAtIndex_5, getItemAtIndex_4)

# group: Get Room Point and Level
location = Room.Location(combine)
# note: From Clockwork Package
level = Custom[Element.Level](element=combine@L2)  # Gets an element's level

# group: Insert Families
byPointAndLevel = FamilyInstance.ByPointAndLevel(familyType=firstItem@L1, point=location@L2, level=level@L2)
