# Dynamo graph DFBP_17_Batch Rename Families.dyn (Dynamo 1.3.2.2480)

# group: Inputs
string = StringInput("M_")
# note: Text to search for
# note: Text to replace with
string_2 = StringInput("mm")

# group: Get Families to Rename
element_types = ElementTypes("Family")
all_elements_of_type = ElementsOfType(element_types)
name = Family.Name(all_elements_of_type)
contains = String.Contains(str=name, searchFor=string)
filterByBoolMask = List.FilterByBoolMask(list=all_elements_of_type, mask=contains)

# group: Rename families
name_2 = Family.Name(filterByBoolMask.in)
# note: From Clockwork Package
replace = String.Replace(str=name_2, searchFor=string, replaceWith=string_2)
setName = Custom[Element.SetName](element=filterByBoolMask.in, name=replace)  # Gets the name of a given Revit element

# group: Rename family types
types = Family.Types()  # unwired: arg0
name_3 = FamilyType.Name(types)
