# Dynamo graph DFBP_18_Insert Multiple Wall-Hosted Families.dyn (Dynamo 2.0.1.5055)

# group: Select Family and Insert into Wall
# note: From WombatDynamo package
family_types = FamilyTypes()  # nothing selected; graph input

# group: Select Wall(s)
select_model_elements = DSModelElementsSelection()  # nothing selected; graph input
select_model_element = DSModelElementSelection()  # nothing selected; graph input

# group: Filter Selection for Walls
getCategory = Element.GetCategory(element=select_model_elements)
string_from_object = FromObject(obj=getCategory)
string = StringInput("Walls")  # graph input
eq = string_from_object == string
filterByBoolMask = List.FilterByBoolMask(list=select_model_elements, mask=eq)

# group: Get Wall Curve and Level
getLocation = Element.GetLocation(element=filterByBoolMask.in)
# note: From Clockwork Package
level = Custom[Element.Level](element=filterByBoolMask.in)  # Gets an element's level

# group: Divide Curve by Distance
number_slider = DoubleSlider(5, range=0..100 step 1)  # graph input
# note: From LunchBox Package
divideCurveByDistance = Geometry.Curves.DivideCurveByDistance(curve=getLocation, Distance=number_slider)

# group: Set Elevation Param Value
string_2 = StringInput("Elevation")  # graph input
number = DoubleInput(1.5)  # graph input
setParameterByName = Element.SetParameterByName(parameterName=string_2, value=number)  # unwired: element

# group: Divide Curve by Number of Points
number_slider_2 = DoubleSlider(8, range=0..100 step 1)  # graph input
# note: From LunchBox Package
divideCurve = Geometry.Curves.DivideCurve(curve=getLocation, Number=number_slider_2)

# group: Remove First and Last Points
number_2 = DoubleInput(0)  # graph input
removeItemAtIndex = List.RemoveItemAtIndex(list=divideCurve.Points@L2, indices=number_2)
count = List.Count(list=removeItemAtIndex@L2)
code_block = CodeBlock(count=count) { count - 1; }
removeItemAtIndex_2 = List.RemoveItemAtIndex(list=removeItemAtIndex@L2, indices=code_block)
