# Dynamo graph DFBP_19_Batch Upgrade Families.dyn (Dynamo 1.3.2.2480)

# group: Get All Files in Directory
directory_path = Directory("C:\Users\micha\Google Drive\Courses\C2017-010_Dynamo for Busy People\Scripts\Paid\18 - Batch Upgrade Families\Doors")
fromPath = DirectoryObject(directory_path)  # "Directory.FromPath"
contents = Directory.Contents(fromPath)

# group: Open then Close and Save File
openDocumentFile = RevitElements.Application.OpenDocumentFile(contents)
# note: From Rhythm Package
boolean = BoolSelector(true)
closeDocument = RevitElements.Application.CloseDocument(openDocumentFile, boolean)

watch = Watch(closeDocument)
upgradeFamilies = Tools.Batch.UpgradeFamilies()  # unwired: arg0
