# Dynamo graph DFBP_20_Create Family Types from Excel.dyn (Dynamo 1.3.2.2480)

# group: Select Family Instance in Model and Get Type
select_model_element = DSModelElementSelection()  # 1 picked in the model
type = FamilyInstance.Type(select_model_element)

# group: Read Excel File
file_path = Filename(".\Window Family Types.xlsx")
fromPath = FileObject(file_path)  # "File.FromPath"
string = StringInput("Sheet1")
readFromFile = Excel.ReadFromFile(file=fromPath, sheetName=string)

# group: Remove Header and Format Data
number = DoubleInput(0)
removeItemAtIndex = List.RemoveItemAtIndex(list=readFromFile, indices=number)
transpose = List.Transpose(removeItemAtIndex)

# group: Get Type Data from Excel
code_block = CodeBlock { 0; 1; 2; }
getItemAtIndex = List.GetItemAtIndex(list=transpose, index=code_block.out0)
getItemAtIndex_2 = List.GetItemAtIndex(list=transpose, index=code_block.out1)
getItemAtIndex_3 = List.GetItemAtIndex(list=transpose, index=code_block.out2)

# group: Get Header Data and Format
number_2 = DoubleInput(0)
getItemAtIndex_4 = List.GetItemAtIndex(list=readFromFile, index=number_2)
code_block_2 = CodeBlock { 1; 2; }
getItemAtIndex_5 = List.GetItemAtIndex(list=getItemAtIndex_4, index=code_block_2.out0)
trimWhitespace = String.TrimWhitespace(getItemAtIndex_5)
getItemAtIndex_6 = List.GetItemAtIndex(list=getItemAtIndex_4, index=code_block_2.out1)
trimWhitespace_2 = String.TrimWhitespace(getItemAtIndex_6)

# group: Duplicate Family Type and Set Param Values
# note: From Springs Package
duplicate = Custom[Springs.ElementType.Duplicate](elementType=type, newName=getItemAtIndex)  # Create duplicate element types. If the type exists, it will be appended instead.

flatten = Flatten(duplicate)

# group (continued): Duplicate Family Type and Set Param Values
setParameterByName = Element.SetParameterByName(element=flatten, parameterName=trimWhitespace, value=getItemAtIndex_2)
setParameterByName_2 = Element.SetParameterByName(element=flatten, parameterName=trimWhitespace_2, value=getItemAtIndex_3)
