# Dynamo graph DFBP_21_Revit Warning Reporter.dyn (Dynamo 2.0.1.5055)

# group: NOTE:
# note: This script only works in Revit version 2018 and higher

# group: Get Warnings
# note: From Bang! package
boolean = BoolSelector(true)  # graph input

# group: Output Warning Types and Counts
uniqueItems = List.UniqueItems()  # unwired: list
watch = Watch(uniqueItems)
contains = List.Contains(list=uniqueItems, lacing=CrossProduct)  # unwired: item
countTrue = List.CountTrue(list=contains@L2)
watch_2 = Watch(countTrue)

# group: Output Total Number of Warnings
count = List.Count()  # unwired: list
watch_3 = Watch(count)

# group: Delete Duplicate Elements
string = StringInput("identical instances")  # graph input
boolean_2 = BoolSelector(true)  # graph input
contains_2 = String.Contains(searchFor=string, ignoreCase=boolean_2)  # unwired: str
filterByBoolMask = List.FilterByBoolMask(mask=contains_2)  # unwired: list
firstItem = List.FirstItem(list=filterByBoolMask.in@L2)
# note: From Springs package
boolean_3 = BoolSelector(false)  # graph input
deleteElements = Custom[Springs.Doc.DeleteElements](element=firstItem, confirm=boolean_3)  # Attempts to delete the input list of elements from the active Revit document.The node returns the number of successfully deleted elements and their Ids as a string. Carefully observe the deleted elements count. It may be greater than the input list because hosted elements or tags will be deleted as well. If an element in the list can not be deleted (for example last revision or last view), the whole list will fail to be deleted.

# group: Export Warnings to Excel
file_path = Filename("..\..\..\..\..\..\Desktop\Warning Output")  # graph input
string_2 = StringInput("Revit Warnings")  # graph input
number = DoubleInput(0)  # graph input
id = Element.Id()  # unwired: element
create = List.Create(item2=id)  # unwired: item0, item1
transpose = List.Transpose(lists=create)
flatten = List.Flatten(list=transpose@L3)
boolean_4 = BoolSelector(true)  # graph input
exportExcel = Data.ExportExcel(filePath=file_path, sheetName=string_2, startRow=number, startCol=number, data=flatten, overWrite=boolean_4)

# group: Isolate Warning Elements in 3D View
string_3 = StringInput("identical instances")  # graph input
boolean_5 = BoolSelector(true)  # graph input
contains_3 = String.Contains(searchFor=string_3, ignoreCase=boolean_5)  # unwired: str
filterByBoolMask_2 = List.FilterByBoolMask(mask=contains_3)  # unwired: list
flatten_2 = List.Flatten(list=filterByBoolMask_2.in)
# note: From archilab package
isolate_in_view = Custom[Isolate in View](Element=flatten_2)  # This node will take input of elements and a view to isolate selected elements in a view.; unwired: View
views = Views()  # nothing selected; graph input
code_block = CodeBlock(name=string_3) { "Warning_" + name; }
