# Dynamo graph DFBP_22_Assign Workset By Category.dyn (Dynamo 2.0.1.5055)

# group: Specify Categories and Create List
categories = Categories(index=604)  # graph input
categories_2 = Categories(index=208)  # graph input
categories_3 = Categories(index=408)  # graph input
create = List.Create(item0=categories, item1=categories_2, item2=categories_3)

# group: Get All Elements
all_elements_of_category = ElementsOfCategory(Category=create)
flatten = List.Flatten(list=all_elements_of_category)

# group: Set Element's Workset
# note: From archilab package
string = StringInput("Workset")  # graph input
setParameterByName = Element.SetParameterByName(element=flatten, parameterName=string)  # unwired: value

# group: Get Workset By Name
# note: From archilab package
string_2 = StringInput("Shell")  # graph input
firstIndexOf = List.FirstIndexOf(item=string_2)  # unwired: list
getItemAtIndex = List.GetItemAtIndex(index=firstIndexOf)  # unwired: list
