# Dynamo graph DFBP_24_Model Statistics.dyn (Dynamo 1.3.2.2480)

# group: File Path
string = StringInput("File name:")
current = Document.Current()
filePath = Document.FilePath(current)
watch = Watch(filePath)
create = List.Create(string, watch)

# group: File Size
string_2 = StringInput("File size:")
size = Custom[Springs.File.Size](path=filePath)  # Outputs the the file size in kilobytes or megabytes. Provide a file path as a string. Set kbOnly to true for a consistent output.
# note: From Springs package
number = DoubleInput(0)
getItemAtIndex = List.GetItemAtIndex(list=size, index=number)
watch_2 = Watch(getItemAtIndex)
create_2 = List.Create(string_2, watch_2)

# group: Revit Version
string_3 = StringInput("Revit version:")
version = Custom[Application.Version]()  # Retrieves the name, version and build of the current Revit application.
# note: From Clockwork package
watch_3 = Watch(version.fullVersion)
create_3 = List.Create(string_3, watch_3)

create_4 = List.Create(create, create_2, create_3)

# group: Number of Warnings
string_4 = StringInput("Number of warnings:")
boolean = BoolSelector(true)
# note: From archilab package
getWarnings = Revit.WarningTools.GetWarnings(boolean)
count = Count(getWarnings)
watch_4 = Watch(count)
create_5 = List.Create(string_4, watch_4)

# group: Number of Identical Instances
string_5 = StringInput("Number of identical instances:")
string_6 = StringInput("identical instances")
boolean_2 = BoolSelector(true)
contains = String.Contains(str=getWarnings, searchFor=string_6, ignoreCase=boolean_2)
countTrue = CountTrue(contains)
watch_5 = Watch(countTrue)
create_6 = List.Create(string_5, watch_5)

create_7 = List.Create(create_5, create_6)

# group: Number of Rooms
string_7 = StringInput("Number of rooms:")
categories = Categories("Rooms")
all_elements_of_category = ElementsOfCategory(categories)
count_2 = Count(all_elements_of_category)
watch_6 = Watch(count_2)
create_8 = List.Create(string_7, watch_6)

# group: Number of Unplaced Rooms
string_8 = StringInput("Number of unplaced rooms:")
area = Room.Area(all_elements_of_category)
number_2 = DoubleInput(1)
lt = area < number_2
countTrue_2 = CountTrue(lt)
watch_7 = Watch(countTrue_2)
create_9 = List.Create(string_8, watch_7)

create_10 = List.Create(create_8, create_9)

# group: Number of View Templates
categories_2 = Categories("Views")
all_elements_of_category_2 = ElementsOfCategory(categories_2)
# note: From Archi-Lab package
clear_list = Custom[Clear List](Input=all_elements_of_category_2)  # This node will remove all Null and Empty Lists from any list.
# note: From Clockwork package
isViewTemplate = Custom[View.IsViewTemplate+](view=clear_list)  # Checks if a given view is a view template. Unlike the OOTB node it works for all view types.
countTrue_3 = CountTrue(isViewTemplate)
string_9 = StringInput("Number of view templates:")
watch_8 = Watch(countTrue_3)
create_11 = List.Create(string_9, watch_8)

# group: Number of Views
string_10 = StringInput("Number of views:")
categories_3 = Categories("Views")
all_elements_of_category_3 = ElementsOfCategory(categories_3)
# note: From Archi-Lab package
clear_list_2 = Custom[Clear List](Input=all_elements_of_category_3)
count_3 = Count(clear_list_2)
sub = count_3 - countTrue_3
watch_9 = Watch(sub)
create_12 = List.Create(string_10, watch_9)

# group: Percentage of Views Using View Template
string_11 = StringInput("Percentage of views using view template:")
filterByBoolMask = List.FilterByBoolMask(list=all_elements_of_category_2, mask=isViewTemplate)
# note: From Clockwork package
viewTemplate = Custom[View.ViewTemplate](view=filterByBoolMask.out)  # Returns the view template assigned to a given view (if one is assigned)
# note: From Archi-Lab package
clear_list_3 = Custom[Clear List](Input=viewTemplate)
count_4 = Count(clear_list_3)
div = count_4 / sub
number_3 = DoubleInput(100)
mul = div * number_3
number_4 = DoubleInput(1)
round = Math.Round(number=mul, digits=number_4)
watch_10 = Watch(round)
create_13 = List.Create(string_11, watch_10)

# group: Starting View
string_12 = StringInput("Starting View:")
boolean_3 = BoolSelector(true)
startingView = Custom[Document.StartingView](toggle=boolean_3)  # Retrieves the starting view of a Project file. Returns null if no starting view is set.
# note: From Clockwork package
name = Element.Name(startingView)
watch_11 = Watch(name)
create_14 = List.Create(string_12, watch_11)

create_15 = List.Create(create_12, create_11, create_13, create_14)

# group: Number of Sheets
string_13 = StringInput("Number of sheets:")
categories_4 = Categories("Sheets")
all_elements_of_category_4 = ElementsOfCategory(categories_4)
count_5 = Count(all_elements_of_category_4)
watch_12 = Watch(count_5)
create_16 = List.Create(string_13, watch_12)

# group: Percentage of Views on Sheets
string_14 = StringInput("Percentage of Views on Sheets:")
# note: From Springs package
views = Custom[Springs.Sheet.Views+](sheet=all_elements_of_category_4)  # Extracts all views and schedules (minus the revision schedule) placed on the input sheet (or sheets). Will be depreciated once the bult in node works with all plan types.
flatten = Flatten(views.view_s)
count_6 = Count(flatten)
div_2 = count_6 / sub
number_5 = DoubleInput(100)
mul_2 = div_2 * number_5
number_6 = DoubleInput(1)
round_2 = Math.Round(number=mul_2, digits=number_6)
watch_13 = Watch(round_2)
create_17 = List.Create(string_14, watch_13)

create_18 = List.Create(create_16, create_17)

# group: Number of Worksets
string_15 = StringInput("Number of worksets:")
# note: From archilab package
getAll = archilab.Revit.Elements.Workset.GetAll()
count_7 = Count(getAll)
watch_14 = Watch(count_7)
create_19 = List.Create(string_15, watch_14)

# group: Number of Design Option Sets and Options
string_16 = StringInput("Number of Design Options:")
# note: From Clockwork package
designOptions = Custom[Document.DesignOptions]()  # Returns all design options in the model, grouped by design option set
flatten_2 = Flatten(designOptions.DesignOptions)
count_8 = Count(flatten_2)
watch_15 = Watch(count_8)
create_20 = List.Create(string_16, watch_15)
string_17 = StringInput("Number of Design Option Sets:")
count_9 = Count(designOptions.DesignOptionSets)
watch_16 = Watch(count_9)
create_21 = List.Create(string_17, watch_16)

create_22 = List.Create(create_19, create_20, create_21)

# group: Number of CAD Links and Imports
string_18 = StringInput("Number of CAD links:")
reportInstances = CAD.ReportInstances()
count_10 = Count(reportInstances.out1)
watch_17 = Watch(count_10)
create_23 = List.Create(string_18, watch_17)
string_19 = StringInput("Number of CAD imports:")
# note: From BimorphNodes package
count_11 = Count(reportInstances.out2)
watch_18 = Watch(count_11)
create_24 = List.Create(string_19, watch_18)

# group: Number of RVT Links
string_20 = StringInput("Number of RVT links:")
# note: From Data-Shapes package
get_all_linked_docs_infos = Custom[Get All Linked Docs infos]()  # Get all linked documents names and paths
count_12 = Count(get_all_linked_docs_infos.Rvt_links_names)
watch_19 = Watch(count_12)
create_25 = List.Create(string_20, watch_19)

create_26 = List.Create(create_23, create_24, create_25)

# group: Number of Wall Types
string_21 = StringInput("Number of wall types:")
element_types = ElementTypes("WallType")
all_elements_of_type = ElementsOfType(element_types)
count_13 = Count(all_elements_of_type)
watch_20 = Watch(count_13)
create_27 = List.Create(string_21, watch_20)

# group: Number of Wall Instances
string_22 = StringInput("Number of wall instances:")
categories_5 = Categories("Walls")
all_elements_of_category_5 = ElementsOfCategory(categories_5)
count_14 = Count(all_elements_of_category_5)
watch_21 = Watch(count_14)
create_28 = List.Create(string_22, watch_21)

# group: Percentage of Wall Types in Use
string_23 = StringInput("Percentage of wall types in use:")
# note: From archilab package
type = archilab.Revit.Elements.Elements.Type(all_elements_of_category_5)
uniqueItems = List.UniqueItems(type)
count_15 = Count(uniqueItems)
div_3 = count_15 / count_13
number_7 = DoubleInput(100)
mul_3 = div_3 * number_7
number_8 = DoubleInput(1)
round_3 = Math.Round(number=mul_3, digits=number_8)
watch_22 = Watch(round_3)
create_29 = List.Create(string_23, watch_22)

create_30 = List.Create(create_27, create_28, create_29)

# group: Number of Text Note Types
string_24 = StringInput("Number of text note types:")
element_types_2 = ElementTypes("TextNoteType")
all_elements_of_type_2 = ElementsOfType(element_types_2)
count_16 = Count(all_elements_of_type_2)
watch_23 = Watch(count_16)
create_31 = List.Create(string_24, watch_23)

# group: Number of Text Notes
string_25 = StringInput("Number of text notes:")
categories_6 = Categories("TextNotes")
all_elements_of_category_6 = ElementsOfCategory(categories_6)
count_17 = Count(all_elements_of_category_6)
watch_24 = Watch(count_17)
create_32 = List.Create(string_25, watch_24)

# group: Percentage of Text Note Types in Use
string_26 = StringInput("Percentage of text note types in use:")
typename = TextNote.Typename(all_elements_of_category_6)
uniqueItems_2 = List.UniqueItems(typename)
count_18 = Count(uniqueItems_2)
div_4 = count_18 / count_16
number_9 = DoubleInput(100)
mul_4 = div_4 * number_9
number_10 = DoubleInput(1)
round_4 = Math.Round(number=mul_4, digits=number_10)
watch_25 = Watch(round_4)
create_33 = List.Create(string_26, watch_25)

# group: Number of Filled Region Types
string_27 = StringInput("Number of filled region types:")
element_types_3 = ElementTypes("FilledRegionType")
all_elements_of_type_3 = ElementsOfType(element_types_3)
count_19 = Count(all_elements_of_type_3)
watch_26 = Watch(count_19)
create_34 = List.Create(string_27, watch_26)

# group: Number of Filled Regions
string_28 = StringInput("Number of filled regions:")
element_types_4 = ElementTypes("FilledRegion")
all_elements_of_type_4 = ElementsOfType(element_types_4)
count_20 = Count(all_elements_of_type_4)
watch_27 = Watch(count_20)
create_35 = List.Create(string_28, watch_27)

# group: Percentage of Text Note Types in Use
string_29 = StringInput("Percentage of filled region types in use:")
name_2 = FilledRegionType.Name(all_elements_of_type_4)
uniqueItems_3 = List.UniqueItems(name_2)
count_21 = Count(uniqueItems_3)
div_5 = count_21 / count_19
number_11 = DoubleInput(100)
mul_5 = div_5 * number_11
number_12 = DoubleInput(1)
round_5 = Math.Round(number=mul_5, digits=number_12)
watch_28 = Watch(round_5)
create_36 = List.Create(string_29, watch_28)

create_37 = List.Create(create_31, create_32, create_33, create_34, create_35, create_36)

# group: Write Data to Excel
file_path = Filename(".\No file selected.xlsx")
string_30 = StringInput("Model Statistics")
number_13 = DoubleInput(0)
join = List.Join(create_4, create_7, create_10, create_15, create_18, create_22, create_26, create_30, create_37)
boolean_4 = BoolSelector(true)
writeToFile = Excel.WriteToFile(filePath=file_path, sheetName=string_30, startRow=number_13, startCol=number_13, data=join, overWrite=boolean_4)
