# Dynamo graph DFBP_Bonus_Export Family Instance and Type Parameters.dyn (Dynamo 1.3.2.2480)

# group: Select Family Instance in Model
select_model_element = DSModelElementSelection()  # 1 picked in the model

# group: Get All Instances of Family
getFamily = FamilyInstance.GetFamily(select_model_element)
types = Family.Types(getFamily)
all_elements_of_family_type = ElementsOfFamilyType(types)

# group: Get Family Name for Excel Worksheet Name
name = Family.Name(getFamily)

# group: Filter Out Empty Family Types
isEmpty = List.IsEmpty(all_elements_of_family_type@L2)
filterByBoolMask = List.FilterByBoolMask(list=all_elements_of_family_type, mask=isEmpty)
flatten = Flatten(filterByBoolMask.out)

# group: Get Instance Parameters and Sort
parameters = Element.Parameters(flatten)
name_2 = Parameter.Name(parameters)
firstItem = List.FirstItem(name_2)
sort = List.Sort(firstItem)

# group: Get Instance Parameter Values and Add Header
getParameterValueByName = Element.GetParameterValueByName(element=flatten, parameterName=sort, lacing=CrossProduct)
addItemToFront = List.AddItemToFront(item=sort, list=getParameterValueByName)

# group: Get Type Parameters and Sort
type = FamilyInstance.Type(flatten)
parameters_2 = Element.Parameters(type)
name_3 = Parameter.Name(parameters_2)
firstItem_2 = List.FirstItem(name_3)
sort_2 = List.Sort(firstItem_2)

# group: Get Type Parameter Values and Add Header
getParameterValueByName_2 = Element.GetParameterValueByName(element=type, parameterName=sort_2, lacing=CrossProduct)
addItemToFront_2 = List.AddItemToFront(item=sort_2, list=getParameterValueByName_2)

# group: Combine Instance and Type Parameter Lists
join = List.Join()  # unwired: arg0, arg1
combine = List.Combine(join, addItemToFront, addItemToFront_2)

# group: Export Data to Excel
file_path = Filename("No file selected.")
number = DoubleInput(0)
boolean = BoolSelector(true)
writeToFile = Excel.WriteToFile(filePath=file_path, sheetName=name, startRow=number, startCol=number, data=combine, overWrite=boolean)
