# Dynamo graph LunchBoxML Testing.dyn (Dynamo 2.0.0.4654)

code_block = CodeBlock()
# ---------- code_block.designscript (3 lines) ----------
"DSCore.List.FilterByBoolMask@var[]..[]_var[]..[]";
"DSCore.String.StartsWith@string_string_bool";
"Revit.Elements.Element.SetParameterByName@string_var";
# ----------------------------------------

# group: Load .csv File
file_path = Filename("C:\Users\patrick.pease\Documents\GitHub\thesaurus\Data Parsing\Output\graphData.csv")
boolean = BoolSelector(false)
importCSV = Data.ImportCSV(filePath=file_path, transpose=boolean)

# group: Sort CSV data into a data set for ML
code_block_2 = CodeBlock { "Nodes"; }
code_block_3 = CodeBlock { 0; 1; }
getItemAtIndex = List.GetItemAtIndex(list=importCSV, index=code_block_3.out0)
getItemAtIndex_2 = List.GetItemAtIndex(list=getItemAtIndex, index=code_block_3.out0)
getItemAtIndex_3 = List.GetItemAtIndex(list=importCSV, index=code_block_3.out1)
getItemAtIndex_4 = List.GetItemAtIndex(list=getItemAtIndex_3, index=code_block_3.out0)
list_create = List.Create(item0=getItemAtIndex_2, item1=getItemAtIndex_4)
list_create_2 = List.Create(item0=getItemAtIndex, item1=getItemAtIndex_3)
transpose = List.Transpose(lists=list_create_2)
createDataTable = Lists.DataSets.CreateDataTable(Name=code_block_2, Headers=list_create, Data=transpose)

# group: LunchBoxML
string = StringInput("DSCore.List.FilterByBoolMask@var[]..[]_var[]..[]")  # graph input
string_2 = StringInput("DSCore.String.StartsWith@string_string_bool")  # graph input
string_3 = StringInput("Living")  # graph input
create = List.Create(item0=string, item1=string_2, item2=string_3)
string_4 = StringInput("Node A Name")  # graph input
string_5 = StringInput("Node B Name")  # graph input
number = DoubleInput(5)  # graph input
naiveBayesClassifier = MachineLearning.Classification.NaiveBayesClassifier(TestInputs=code_block.out1, TrainingData=createDataTable, InputColumnNames=string_4, OutputColumnName=string_5, seed=number)

# group: Result
map = List.Map(list=create, f_x=naiveBayesClassifier.Result)

watch = Watch(createDataTable)
string_6 = StringInput("Bath")  # graph input
string_7 = StringInput("Bedroom")  # graph input
string_8 = StringInput("Living")  # graph input
create_2 = List.Create(item0=string_6, item1=string_7, item2=string_8)
string_9 = StringInput("Rooms")  # graph input
string_10 = StringInput("ID")  # graph input
string_11 = StringInput("Name")  # graph input
string_12 = StringInput("Department")  # graph input
create_3 = List.Create(item0=string_10, item1=string_11, item2=string_12)
# note: Naive Bayes Classifier
# note: Copyright (c) Proving Ground LLC 2017
boolean_2 = BoolSelector(true)  # graph input
lunchbox_room_element_collector = Custom[LunchBox Room Element Collector](Toggle=boolean_2)  # Collects rooms from the Revit document
string_13 = StringInput("Department")  # graph input
getParameterValueByName = Element.GetParameterValueByName(element=lunchbox_room_element_collector.Element, parameterName=string_13)
create_4 = List.Create(item0=lunchbox_room_element_collector.Element_ID, item1=lunchbox_room_element_collector.Name, item2=getParameterValueByName)
transpose_2 = List.Transpose(lists=create_4)
createDataTable_2 = Lists.DataSets.CreateDataTable(Name=string_9, Headers=create_3, Data=transpose_2)
string_14 = StringInput("Name")  # graph input
string_15 = StringInput("Department")  # graph input
number_2 = DoubleInput(5)  # graph input
naiveBayesClassifier_2 = MachineLearning.Classification.NaiveBayesClassifier(TrainingData=createDataTable_2, InputColumnNames=string_14, OutputColumnName=string_15, seed=number_2)  # unwired: TestInputs
map_2 = List.Map(list=create_2, f_x=naiveBayesClassifier_2.Result)
watch_2 = Watch(naiveBayesClassifier.Numeric)
watch_3 = Watch(naiveBayesClassifier.Result)
watch_4 = Watch(naiveBayesClassifier.Probabilities)
